# Grasshopper definition Tower1.gh (Grasshopper 1.0.7)

# ---- group: RH_IN:size
number_slider = Slider(10, range=0..10)

# ---- group: RH_IN:connection
number_slider_2 = Slider(10, range=0..10)

# ----
rectangle = Rectangle(Plane=PlaneXY(0, 0, 0), XSize=number_slider, YSize=number_slider, Radius=0)  # -> Rectangle, Length
mesh_sphere = MeshSphere(Base=PlaneXY(0, 0, 0), Radius=number_slider_2, UCount=10, VCount=20)
box_rectangle = BoxRectangle(Rectangle=rectangle.Rectangle, Height=number_slider)
box_array = BoxArray(Geometry=box_rectangle, Cell=mesh_sphere, XCount=4, YCount=3, ZCount=number_slider)  # -> Geometry, Transform
mesh_box = MeshBox(Base=box_array.Geometry, XCount=10, YCount=10, ZCount=10)

# ---- group: RH_OUT:mesh
mesh = Mesh(mesh_box)
